# Dynamo graph Foundation Annotation.dyn (Dynamo 2.1.0.7500)

# group: Common Text Settings
views = Views("Foundation Layout - Work JCF")  # graph input
text_offset = IntegerSlider(1000, range=0..2000 step 5)  # graph input
text_rotation = IntegerSlider(45, range=0..90 step 5)  # graph input

# group: Grid Intersection Points
lettered_grids = CodeBlock()
# ---------- lettered_grids.designscript (3 lines) ----------
["A", "Aa", "Ab", "Ac", "B", "Ba", "Bb","Bc", "Bd", "C", "Ca", "Cb", "Cc", "Cd",
"Ce", "D", "Da", "Db", "Dc", "Dd", "De", "E", "Ea", "Eb", "Ec", "Ed", "F", "Fa",
"Fb", "Fc", "Fd", "G", "Ga"];
# ----------------------------------------
numbered_grids = CodeBlock()
# ---------- numbered_grids.designscript (4 lines) ----------
["1.2", "1.1", "1", "2", "3", "4", "5", "6", "7", "8", "9", "10", "11", "12",
"13","14", "15", "16", "17", "18", "19", "20", "20a", "21", "21a", "22", "22a",
"23", "24", "25", "26", "27", "28", "29", "30", "31", "32", "33", "34", "35",
"36", "37", "38", "39", "40", "41", "42"];
# ----------------------------------------
index = Python(IN[0]=lettered_grids, IN[1]=numbered_grids)
# ---------- index.python (20 lines) ----------
# Load the Python Standard and DesignScript Libraries
import sys
import clr
clr.AddReference('ProtoGeometry')
from Autodesk.DesignScript.Geometry import *

# The inputs to this node will be stored as a list in the IN variables.
dataEnteringNode = IN

output = []

letter_index = [x for x in range(len(IN[0]))]
number_index = [y for y in range(len(IN[1]))]

# Place your code below this line
for x in letter_index:
	output += [[x, y] for y in number_index] 

# Assign your output to the OUT variable.
OUT = output
# ----------------------------------------
intersections = Python(IN[0]=lettered_grids, IN[1]=numbered_grids)
# ---------- intersections.python (17 lines) ----------
# Load the Python Standard and DesignScript Libraries
import sys
import clr
clr.AddReference('ProtoGeometry')
from Autodesk.DesignScript.Geometry import *

# The inputs to this node will be stored as a list in the IN variables.
dataEnteringNode = IN

output = []

# Place your code below this line
for x in IN[0]:
	output += [str(x) + str(y) for y in IN[1]] 

# Assign your output to the OUT variable.
OUT = output
# ----------------------------------------

# group: Pull Excel Data
csv_file = Filename(".\Foundations_Dynamo.csv")  # graph input
importCSV = Data.ImportCSV(filePath=csv_file)
grid_Ref = Python(IN[0]=importCSV)
# ---------- grid_Ref.python (18 lines) ----------
# Load the Python Standard and DesignScript Libraries
import sys
import clr
import re
clr.AddReference('ProtoGeometry')
from Autodesk.DesignScript.Geometry import *

# The inputs to this node will be stored as a list in the IN variables.
dataEnteringNode = IN

# Place your code below this line
output = IN[0][0][1:]

for x in range(len(output)):
	output[x] = re.sub("\([a-z]\)", "", output[x])
	
# Assign your output to the OUT variable.
OUT = output
# ----------------------------------------
lettered_Grid_Offset_mm = Python(IN[0]=importCSV)
# ---------- lettered_Grid_Offset_mm.python (14 lines) ----------
# Load the Python Standard and DesignScript Libraries
import sys
import clr
clr.AddReference('ProtoGeometry')
from Autodesk.DesignScript.Geometry import *

# The inputs to this node will be stored as a list in the IN variables.
dataEnteringNode = IN

# Place your code below this line
output = IN[0][2][1:]

# Assign your output to the OUT variable.
OUT = output
# ----------------------------------------
numbered_Grid_Offset_mm = Python(IN[0]=importCSV)
# ---------- numbered_Grid_Offset_mm.python (14 lines) ----------
# Load the Python Standard and DesignScript Libraries
import sys
import clr
clr.AddReference('ProtoGeometry')
from Autodesk.DesignScript.Geometry import *

# The inputs to this node will be stored as a list in the IN variables.
dataEnteringNode = IN

# Place your code below this line
output = IN[0][3][1:]

# Assign your output to the OUT variable.
OUT = output
# ----------------------------------------
foundation_Information = Python(IN[0]=importCSV)
# ---------- foundation_Information.python (43 lines) ----------
# Load the Python Standard and DesignScript Libraries
import sys
import clr
clr.AddReference('ProtoGeometry')
from Autodesk.DesignScript.Geometry import *

# The inputs to this node will be stored as a list in the IN variables.
dataEnteringNode = IN

# Place your code below this line
f_type = IN[0][4][1:]

x_mm = IN[0][7][1:]
y_mm = IN[0][8][1:]
depth_mm = IN[0][9][1:]
piles = IN[0][10][1:]
pile_dia = IN[0][11][1:]
design = IN[0][18][1:]
mesh = IN[0][20][1:]
comments = IN[0][19][1:]

output = []
test = []

for i in range(len(f_type)):
	if f_type[i] == "Pad" and design[i] == "Yes" and mesh[i] is not None:
		output.append(str(x_mm[i]) + " x " + str(y_mm[i]) + " x " + str(depth_mm[i]) + "mm Deep Pad\n" + str(mesh[i]))
		test.append("Okay")
	elif f_type[i] == "Pad" and design[i] == "Yes":
		output.append(str(x_mm[i]) + " x " + str(y_mm[i]) + " x " + str(depth_mm[i]) + "mm Deep Pad")
		test.append("Okay")
	elif f_type[i] == "Piled" and design[i] == "Yes":
		output.append(str(piles[i]) + "No. " + str(pile_dia[i]) + " Dia Piles\n" + str(x_mm[i]) + " x " + str(y_mm[i]) + " x " + str(depth_mm[i]) + "mm Dp Pilecap")
		test.append("Okay")
	elif comments[i] is not None:
		output.append("Design incomplete\n" + str(comments[i]))
		test.append("Design incomplete")
	else:
		output.append("Design incomplete")
		test.append("Design incomplete")

# Assign your output to the OUT variable.
OUT = [output, test]
# ----------------------------------------
code_block = CodeBlock(x=foundation_Information) { x[0]; x[1]; }
full_Grid_Ref = Python(IN[0]=importCSV)
# ---------- full_Grid_Ref.python (14 lines) ----------
# Load the Python Standard and DesignScript Libraries
import sys
import clr
clr.AddReference('ProtoGeometry')
from Autodesk.DesignScript.Geometry import *

# The inputs to this node will be stored as a list in the IN variables.
dataEnteringNode = IN

# Place your code below this line
output = IN[0][0][1:]

# Assign your output to the OUT variable.
OUT = output
# ----------------------------------------
foundation_Ref = Python(IN[0]=importCSV)
# ---------- foundation_Ref.python (14 lines) ----------
# Load the Python Standard and DesignScript Libraries
import sys
import clr
clr.AddReference('ProtoGeometry')
from Autodesk.DesignScript.Geometry import *

# The inputs to this node will be stored as a list in the IN variables.
dataEnteringNode = IN

# Place your code below this line
output = IN[0][1][1:]

# Assign your output to the OUT variable.
OUT = output
# ----------------------------------------
depth_mm = Python(IN[0]=importCSV)
# ---------- depth_mm.python (14 lines) ----------
# Load the Python Standard and DesignScript Libraries
import sys
import clr
clr.AddReference('ProtoGeometry')
from Autodesk.DesignScript.Geometry import *

# The inputs to this node will be stored as a list in the IN variables.
dataEnteringNode = IN

# Place your code below this line
depth_mm = IN[0][9][1:]

# Assign your output to the OUT variable.
OUT = depth_mm
# ----------------------------------------
x_mm = Python(IN[0]=importCSV)
# ---------- x_mm.python (14 lines) ----------
# Load the Python Standard and DesignScript Libraries
import sys
import clr
clr.AddReference('ProtoGeometry')
from Autodesk.DesignScript.Geometry import *

# The inputs to this node will be stored as a list in the IN variables.
dataEnteringNode = IN

# Place your code below this line
x_mm = IN[0][7][1:]

# Assign your output to the OUT variable.
OUT = x_mm
# ----------------------------------------
y_mm = Python(IN[0]=importCSV)
# ---------- y_mm.python (14 lines) ----------
# Load the Python Standard and DesignScript Libraries
import sys
import clr
clr.AddReference('ProtoGeometry')
from Autodesk.DesignScript.Geometry import *

# The inputs to this node will be stored as a list in the IN variables.
dataEnteringNode = IN

# Place your code below this line
y_mm = IN[0][8][1:]

# Assign your output to the OUT variable.
OUT = y_mm
# ----------------------------------------
rotation = Python(IN[0]=importCSV)
# ---------- rotation.python (14 lines) ----------
# Load the Python Standard and DesignScript Libraries
import sys
import clr
clr.AddReference('ProtoGeometry')
from Autodesk.DesignScript.Geometry import *

# The inputs to this node will be stored as a list in the IN variables.
dataEnteringNode = IN

# Place your code below this line
r_deg = IN[0][21][1:]

# Assign your output to the OUT variable.
OUT = r_deg
# ----------------------------------------

# group: Get Grid Data
categories = Categories("OST_Grids")  # graph input
all_elements_of_category = ElementsOfCategory(Category=categories)
curve = Grid.Curve(grid=all_elements_of_category)
code_block_2 = CodeBlock { "Name"; }
parameterByName = Parameter.ParameterByName(element=all_elements_of_category, name=code_block_2)
value = Parameter.Value(parameter=parameterByName)

# group: Find Grid Intersections
indexOf = List.IndexOf(list=value, element=lettered_grids)
getItemAtIndex = List.GetItemAtIndex(list=curve, index=indexOf)
indexOf_2 = List.IndexOf(list=value, element=numbered_grids)
getItemAtIndex_2 = List.GetItemAtIndex(list=curve, index=indexOf_2)
intersect = Geometry.Intersect(geometry=getItemAtIndex, other=getItemAtIndex_2, lacing=CrossProduct)
X = Point.X(point=intersect)
round = Math.Round(number=X)
Y = Point.Y(point=intersect)
round_2 = Math.Round(number=Y)

# group: Data Cleaning
isNull = Object.IsNull(obj=lettered_Grid_Offset_mm)
code_block_3 = CodeBlock { 0; }
if_ = If(test=isNull, true=code_block_3, false=lettered_Grid_Offset_mm)
isNull_2 = Object.IsNull(obj=numbered_Grid_Offset_mm)
code_block_4 = CodeBlock { 0; }
if_2 = If(test=isNull_2, true=code_block_4, false=numbered_Grid_Offset_mm)
isNull_3 = Object.IsNull(obj=x_mm)
code_block_5 = CodeBlock { 0; }
if_3 = If(test=isNull_3, true=code_block_5, false=x_mm)
isNull_4 = Object.IsNull(obj=y_mm)
code_block_6 = CodeBlock { 0; }
if_4 = If(test=isNull_4, true=code_block_6, false=y_mm)
isNull_5 = Object.IsNull(obj=rotation)
code_block_7 = CodeBlock { 0; }
if_5 = If(test=isNull_5, true=code_block_7, false=rotation)

# group: Find Notation Location
indexOf_3 = List.IndexOf(list=intersections, element=grid_Ref)
code_block_8 = CodeBlock(x=index, y=indexOf_3) { x[y]; }
python_script = Python(IN[0]=code_block_8, IN[1]=round, IN[2]=round_2, IN[3]=if_, IN[4]=if_2)
# ---------- python_script.python (26 lines) ----------
# Load the Python Standard and DesignScript Libraries
import sys
import clr
clr.AddReference('ProtoGeometry')
from Autodesk.DesignScript.Geometry import *

# The inputs to this node will be stored as a list in the IN variables.
dataEnteringNode = IN

# Place your code below this line
index1 = IN[0]

x_co = IN[1]
y_co = IN[2]

x_offset = IN[4]
y_offset = IN[3]

output = []

for i in range(len(IN[0])):
	x = IN[0][i]
	output.append((x_co[x[0]][x[1]][0] + x_offset[i], y_co[x[0]][x[1]][0]- y_offset[i]))

# Assign your output to the OUT variable.
OUT = output
# ----------------------------------------

# group: Split Complete and Incomplete
code_block_9 = CodeBlock(x=code_block.out1) { x == "Design incomplete"; }
python_script_2 = Python(IN[0]=code_block_9)
# ---------- python_script_2.python (26 lines) ----------
# Load the Python Standard and DesignScript Libraries
import sys
import clr
clr.AddReference('ProtoGeometry')
from Autodesk.DesignScript.Geometry import *

# The inputs to this node will be stored as a list in the IN variables.
dataEnteringNode = IN

# Place your code below this line
index_list = IN[0]
list_length = len(index_list)
i = 0

true_list = []
false_list = []

while i < list_length:
	if index_list[i] == True:
		true_list.append(i)
	else:
		false_list.append(i)
	i += 1

# Assign your output to the OUT variable.
OUT = [true_list, false_list]
# ----------------------------------------
code_block_10 = CodeBlock(x=python_script_2) { x[1]; x[0]; }

# group: Notation
code_block_11 = CodeBlock(a=full_Grid_Ref, b=foundation_Ref, c=code_block.out0) { "Grid Ref: " + a + "\nFound. Ref: " + b + "\n" + c; }

# group: Complete Designs
getItemAtIndex_3 = List.GetItemAtIndex(list=python_script, index=code_block_10.out0)
getItemAtIndex_4 = List.GetItemAtIndex(list=python_script, index=code_block_10.out0)
getItemAtIndex_5 = List.GetItemAtIndex(list=code_block_11, index=code_block_10.out0)
watch = Watch(getItemAtIndex_5)
getItemAtIndex_6 = List.GetItemAtIndex(list=if_3, index=code_block_10.out0)
getItemAtIndex_7 = List.GetItemAtIndex(list=if_4, index=code_block_10.out0)
getItemAtIndex_8 = List.GetItemAtIndex(list=if_5, index=code_block_10.out0)

# group: Add Text to Mark-up
python_script_3 = Python(IN[0]=getItemAtIndex_3)
# ---------- python_script_3.python (14 lines) ----------
# Load the Python Standard and DesignScript Libraries
import sys
import clr
clr.AddReference('ProtoGeometry')
from Autodesk.DesignScript.Geometry import *

# The inputs to this node will be stored as a list in the IN variables.
dataEnteringNode = IN

# Place your code below this line


# Assign your output to the OUT variable.
OUT = [IN[0][x][0] for x in range(len(IN[0]))]
# ----------------------------------------
python_script_4 = Python(IN[0]=getItemAtIndex_4)
# ---------- python_script_4.python (14 lines) ----------
# Load the Python Standard and DesignScript Libraries
import sys
import clr
clr.AddReference('ProtoGeometry')
from Autodesk.DesignScript.Geometry import *

# The inputs to this node will be stored as a list in the IN variables.
dataEnteringNode = IN

# Place your code below this line


# Assign your output to the OUT variable.
OUT = [IN[0][x][1] for x in range(len(IN[0]))]
# ----------------------------------------
code_block_12 = CodeBlock { 0; }
byCoordinates = Point.ByCoordinates(x=python_script_3, y=python_script_4, z=code_block_12)
translate = Geometry.Translate(geometry=byCoordinates, xTranslation=text_offset, yTranslation=text_offset)
code_block_13 = CodeBlock { "Left"; }
code_block_14 = CodeBlock { "2.5 blue"; }
byName = TextNoteType.ByName(name=code_block_14)
byLocation = TextNote.ByLocation(view=views, location=translate, text=watch, alignment=code_block_13, type=byName, rotation=text_rotation)

# group: Draw General Foundation Area
python_script_5 = Python(IN[0]=python_script_3, IN[1]=getItemAtIndex_6, IN[2]=python_script_4, IN[3]=getItemAtIndex_7, IN[4]=getItemAtIndex_8)
# ---------- python_script_5.python (38 lines) ----------
# Load the Python Standard and DesignScript Libraries
import sys
import clr
import math
clr.AddReference('ProtoGeometry')
from Autodesk.DesignScript.Geometry import *

# The inputs to this node will be stored as a list in the IN variables.
dataEnteringNode = IN

a = IN[0]
x = IN[1]
b = IN[2]
y = IN[3]
rotation = IN[4]

deg_to_rad = lambda x: 2 * math.pi * x / 360

output = [[], []]

for i in range(len(a)):
	output[0].append([
		a[i] - ((math.cos(deg_to_rad(rotation[i])) * x[i]/2) - (math.sin(deg_to_rad(rotation[i])) * y[i]/2)),
		a[i] + ((math.cos(deg_to_rad(rotation[i])) * x[i]/2) + (math.sin(deg_to_rad(rotation[i])) * y[i]/2)),
		a[i] + ((math.cos(deg_to_rad(rotation[i])) * x[i]/2) - (math.sin(deg_to_rad(rotation[i])) * y[i]/2)),
		a[i] - ((math.cos(deg_to_rad(rotation[i])) * x[i]/2) + (math.sin(deg_to_rad(rotation[i])) * y[i]/2))
		])
	output[1].append([
		b[i] - ((math.cos(deg_to_rad(rotation[i])) * y[i]/2) + (math.sin(deg_to_rad(rotation[i])) * x[i]/2)),
		b[i] - ((math.cos(deg_to_rad(rotation[i])) * y[i]/2) - (math.sin(deg_to_rad(rotation[i])) * x[i]/2)),
		b[i] + ((math.cos(deg_to_rad(rotation[i])) * y[i]/2) + (math.sin(deg_to_rad(rotation[i])) * x[i]/2)),
		b[i] + ((math.cos(deg_to_rad(rotation[i])) * y[i]/2) - (math.sin(deg_to_rad(rotation[i])) * x[i]/2))
		])

# Place your code below this line

# Assign your output to the OUT variable.
OUT = output
# ----------------------------------------
code_block_15 = CodeBlock(x=python_script_5) { x[0]; x[1]; }
code_block_16 = CodeBlock { 47700; }
byCoordinates_2 = Point.ByCoordinates(x=code_block_15.out0, y=code_block_15.out1, z=code_block_16)
code_block_17 = CodeBlock { true; }
byPoints = PolyCurve.ByPoints(points=byCoordinates_2, connectLastToFirst=code_block_17)
code_block_18 = CodeBlock { false; }
clean = List.Clean(list=byPoints, preserveIndices=code_block_18)
curves = PolyCurve.Curves(polyCurve=clean)
filled_region_complete_designs = FilledRegionTypes("Solid Green Transparent")  # graph input
byCurves = FilledRegion.ByCurves(view=views, boundary=curves, regionType=filled_region_complete_designs)

# group: Incomplete Designs
getItemAtIndex_9 = List.GetItemAtIndex(list=python_script, index=code_block_10.out1)
getItemAtIndex_10 = List.GetItemAtIndex(list=python_script, index=code_block_10.out1)
getItemAtIndex_11 = List.GetItemAtIndex(list=code_block_11, index=code_block_10.out1)
watch_2 = Watch(getItemAtIndex_11)
getItemAtIndex_12 = List.GetItemAtIndex(list=if_3, index=code_block_10.out1)
getItemAtIndex_13 = List.GetItemAtIndex(list=if_4, index=code_block_10.out1)
getItemAtIndex_14 = List.GetItemAtIndex(list=if_5, index=code_block_10.out1)

# group: Add Text to Mark-up
python_script_6 = Python(IN[0]=getItemAtIndex_9)  # same code as python_script_3
python_script_7 = Python(IN[0]=getItemAtIndex_10)  # same code as python_script_4
code_block_19 = CodeBlock { 0; }
byCoordinates_3 = Point.ByCoordinates(x=python_script_6, y=python_script_7, z=code_block_19)
translate_2 = Geometry.Translate(geometry=byCoordinates_3, xTranslation=text_offset, yTranslation=text_offset)
code_block_20 = CodeBlock { "Left"; }
code_block_21 = CodeBlock { "2.5 red"; }
byName_2 = TextNoteType.ByName(name=code_block_21)
byLocation_2 = TextNote.ByLocation(view=views, location=translate_2, text=watch_2, alignment=code_block_20, type=byName_2, rotation=text_rotation)

# group: Draw General Foundation Area
python_script_8 = Python(IN[0]=python_script_6, IN[1]=getItemAtIndex_12, IN[2]=python_script_7, IN[3]=getItemAtIndex_13, IN[4]=getItemAtIndex_14)  # same code as python_script_5
code_block_22 = CodeBlock(x=python_script_8) { x[0]; x[1]; }
code_block_23 = CodeBlock { 47700; }
byCoordinates_4 = Point.ByCoordinates(x=code_block_22.out0, y=code_block_22.out1, z=code_block_23)
code_block_24 = CodeBlock { true; }
byPoints_2 = PolyCurve.ByPoints(points=byCoordinates_4, connectLastToFirst=code_block_24)
code_block_25 = CodeBlock { false; }
clean_2 = List.Clean(list=byPoints_2, preserveIndices=code_block_25)
curves_2 = PolyCurve.Curves(polyCurve=clean_2)
filled_region_incomplete_designs = FilledRegionTypes("Solid Orange Transparent")  # graph input
byCurves_2 = FilledRegion.ByCurves(view=views, boundary=curves_2, regionType=filled_region_incomplete_designs)
